# Grasshopper definition images_to_mesh_matrix.gh (Grasshopper 1.0.7)
# plug-ins: GH_CPython

# ---- group: RH_IN:int_select
number_slider = Slider(0, range=0..1)

# ----
# Change folder when deploy
panel = Panel("D:\AEC Tech\Layout5\RhinoAppServerTest\compute.rhino3d.appserver\src\images")
gh_cpython = GH_CPython(folder=panel, x=number_slider)  # -> files; inputs folder: list, x: list
#   port folder: [required] - [type = int] - [default = None] Descripe your input here * bullet point. * bullet point
#   port files: indicate your output description here. refers to a new line.
# ---------- gh_cpython: Python ----------
import glob

path = _folder + '\*.png'
print(path)
files_ = glob.glob(_folder + '\*.png')
# ---------- end gh_cpython ----------
halfwidth = Slider(10, range=0..100)
columns = Slider(6, range=0..10)
txt = Text(gh_cpython)
multiplication = Multiplication(A=halfwidth, B="2")
split = TextSplit(Text=txt, Separators="'")
neg = Negative(Value=halfwidth)
panel_2 = Panel(multiplication)
item = ListItem(List=split, Index=Slider(1, range=0..1), Wrap=True)  # -> flatten(Item)
eval = Evaluate(F="x-1", x=columns)
eval_2 = Evaluate(F="x/(y-1)", x=multiplication, y=columns)
clean = CleanTree(RemoveNulls=True, RemoveInvalid=True, RemoveEmpty=True, Tree=item)
lng = ListLength(List=clean)
eval_3 = Evaluate(F="x\y + 1", x=lng, y=columns)
eval_4 = Evaluate(F="-x*y/2", x=eval_3, y=eval_2)
pt = ConstructPoint(XCoordinate=neg, YCoordinate=eval_4, ZCoordinate=0)
sqgrid = Square(Plane=pt, Size=eval_2, ExtentX=eval, ExtentY=eval_3)  # -> Cells, Points
panel_3 = Panel(eval_2)
num = Number(eval_2)
rev = ReverseList(List=sqgrid.Points)
pt_2 = Point(sqgrid.Points)
flip = FlipMatrix(Data=rev)  # -> flatten(Data)
short = ShortestList(ListA=clean, ListB=flip, TrimMode=2)  # -> ListA, ListB
number_slider_2 = Slider(100, range=0..100)
rectangle = Rectangle(Plane=short.ListB, XSize=num, YSize=num, Radius=0)  # -> Rectangle, Length
img = ImportImage(File=short.ListA, Rectangle=rectangle.Rectangle, XSamples=number_slider_2, YSamples=number_slider_2)  # -> flatten(Image)
mjoin = MeshJoin(Meshes=img)

# ---- group: RH_OUT:mesh_m
mesh = Mesh(mjoin)
